# Grasshopper definition Util_StairsFromPlanSteps.gh (Grasshopper 0.9.62)
# Copyright: Nono 2014

floorheight = Slider(2.89, range=0..10)
crv = Curve(graft([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]))
crv_2 = Curve(graft([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]))
crv_3 = Curve(graft([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]))
cluster = Cluster(graftedoutlines=[crv_2, crv_3, crv], floorheight=floorheight)

# ==== cluster Cluster
graftedoutlines = ClusterInput()
floorheight = ClusterInput()  # Floor height from floor level to floor level.
crv = Curve(graftedoutlines)
flip = FlipMatrix(Data=crv)
null = NullItem(Item=flip)  # -> NullFlags, InvalidFlags, Description
dispatch = Dispatch(List=flip, DispatchPattern=null.NullFlags)  # -> ListA, ListB
lng = ListLength(List=dispatch.ListB)
division = Division(A=floorheight, B=lng)
series = Series(Start=0, Step=division, Count=lng)
Z = UnitZ(Factor=series)
move = Move(Geometry=flip, Motion=Z)  # -> Geometry, Transform
boundary = BoundarySurfaces(Edges=move.Geometry)
srf = ClusterOutput(boundary)
